# Dynamo graph ParasiteDynamo.dyn (Dynamo 2.1.0.7500)

string = StringInput("GHBreps")
receive = Parasite.IO.Dynamo.GetData.Receive(id=string)
code_block = CodeBlock { 0.5; }
pointAtParameter = Surface.PointAtParameter(surface=receive, u=code_block, v=code_block)
normalAtPoint = Surface.NormalAtPoint(surface=receive, point=pointAtParameter)
perimeterCurves = Surface.PerimeterCurves(surface=receive)
