# Dynamo graph Send_Spheres.dyn "DynamoToGH_Spheres" (Dynamo 2.1.0.7500)

string = StringInput("FromDyn")
code_block = CodeBlock { 0..30..#50; }
code_block_2 = CodeBlock(t=code_block) { t; Math.Sin(Math.RadiansToDegrees(t)); Math.Cos(Math.RadiansToDegrees(t)); }
byCoordinates = Point.ByCoordinates(x=code_block_2.t, y=code_block_2.out1, z=code_block_2.out2)
number = DoubleInput(0.5)
byCenterPointRadius = Sphere.ByCenterPointRadius(centerPoint=byCoordinates, radius=number)
parasiteSender = Parasite.Dynamo.Nodes.ParasiteSender.ParasiteSender(id=string, dat0=byCenterPointRadius)
