# Grasshopper definition ParasitePushTest_Breps.gh (Grasshopper 1.0.7)
# plug-ins: ParasiteIOGrasshopper, LunchBox, Kangaroo2 Components

crv = Curve(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)
scale = Scale(Geometry=crv, Center=Point(0, 0, 0), Factor=Slider(2, range=0..10))  # -> Geometry, Transform
pframes = PerpFrames(Curve=scale.Geometry, Count=Slider(94, range=0..100), Align=True)  # -> Frames, Parameters
rectangle = Rectangle(Plane=pframes.Frames, XSize=Domain(-10, 10), YSize=Domain(-8, 8), Radius=0)  # -> Rectangle, Length
lng = ListLength(List=rectangle.Rectangle)
series = Series(Start=0, Step=1, Count=lng)
graph = GraphMapper(series, x0=0, x1=1, y0=0, y1=1, container_name="Sine", Equation_px=[0, 0.5064175129], Equation_py=[0, 0.644244194])
dom = ConstructDomain(DomainStart=Slider(0, range=0..100), DomainEnd=Slider(360, range=0..1000))
remap = RemapNumbers(Value=graph, Source=Domain(0, 1), Target=dom)  # -> Mapped, Clipped
sort = SortList(Keys=remap.Mapped)  # -> Keys, ValuesA
rotate = Rotate(Geometry=rectangle.Rectangle, Angle=degrees(sort.Keys), Plane=pframes.Frames)  # -> Geometry, Transform
explode = Explode(Curve=rotate.Geometry, Recursive=True)  # -> Segments, simplify(Vertices)
number_slider = Slider(20, range=0..20)
duppt = RemoveDuplicatePts(Points=explode.Vertices, Tolerance=0.01)
item = ListItem(List=duppt, Index=0, Wrap=True)  # -> Item, Item1, Item2, Item3
srf = Surface(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)
quads = QuadPanels(Surface=srf, UDivisions=number_slider, VDivisions=number_slider)
srf4pt = _4PointSurface(CornerA=item.Item, CornerB=item.Item1, CornerC=item.Item2, CornerD=item.Item3)  # -> flatten(Surface)
brep = Brep(quads)
brep_2 = Brep(srf4pt)
send = Send(Send=Toggle(False), Id="GH_Breps", Data=brep)
