# Grasshopper definition ParasitePushTest_BrepsSolid.gh (Grasshopper 1.0.7)
# plug-ins: ParasiteIOGrasshopper

brep = Brep([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])
pop2d = Populate2D(Region={Plane=PlaneXY(35, 35, 0), Size=Domain2(u=-35..35, v=-35..35)}, Count=Slider(166, range=0..1000), Seed=1)
rectangle = Rectangle(Plane=pop2d, XSize=Domain(-1, 1), YSize=Domain(-1, 1), Radius=0)  # -> Rectangle, Length
lng = ListLength(List=rectangle.Rectangle)
series = Series(Start=0, Step=1, Count=lng)
graph = GraphMapper(series, x0=0, x1=1, y0=0, y1=1, container_name="Sine", Equation_px=[0, 0.3181101382], Equation_py=[0, 0.8325827718])
dom = ConstructDomain(DomainStart=Slider(4, range=0..10), DomainEnd=Slider(30, range=0..100))
remap = RemapNumbers(Value=graph, Source=Domain(0, 1), Target=dom)  # -> Mapped, Clipped
Z = UnitZ(Factor=remap.Mapped)
extr = Extrude(Base=rectangle.Rectangle, Direction=Z)
cap = CapHoles(Brep=extr)
brep_2 = Brep(cap)
send = Send(Send=Toggle(False), Id="GHSolidBReps", Data=brep_2)
