# Grasshopper definition ParasitePushTest_Mesh.gh (Grasshopper 1.0.7)
# plug-ins: ParasiteIOGrasshopper, LunchBox

number_slider = Slider(4, range=0..10)
msphere = MeshSphere(Base=PlaneXY(0, 0, 0), Radius=10, UCount=number_slider, VCount=number_slider)
klein = KleinSurface(
    UDivisions=96,
    VDivisions=91,
    RParameter=Slider(2, range=0..10),
    TParameter=Slider(0.5, range=0..2),
    Scale=Slider(8, range=0..10),
    Domain1=Domain(0, 12.56637061),
    Domain2=Domain(0, 3.141592654))
number_slider_2 = Slider(150, range=0..150)
tri = Triangulate(Mesh=msphere)  # -> Mesh, Count
demesh = DeconstructMesh(Mesh=tri.Mesh)  # -> Vertices, Faces, Colours, Normals
mesh_uv = MeshSurface(Surface=klein, UCount=Slider(1000, range=0..1000), VCount=Slider(150, range=0..150), Overhang=True, Equalize=False)
move = Move(Geometry=mesh_uv, Motion=Vector(0, 0, 10))  # -> Geometry, Transform
send = Send(Id="GH_mesh", Data=move.Geometry)
pdecon = Deconstruct(Point=demesh.Vertices)  # -> XComponent, YComponent, ZComponent
bnd = Bounds(Numbers=pdecon.ZComponent)
dedomain = DeconstructDomain(Domain=bnd)  # -> Start, End
gradient = Gradient(
    LowerLimit=dedomain.Start,
    UpperLimit=dedomain.End,
    Parameter=pdecon.ZComponent,
    stops=[0: RGB(234, 38, 0), 0.25: RGB(234, 126, 0), 0.5: RGB(254, 244, 84), 0.75: RGB(173, 203, 249), 1: RGB(75, 107, 169)])
conmesh = ConstructMesh(Vertices=demesh.Vertices, Faces=demesh.Faces, Colours=gradient)
