# Grasshopper definition ParasitePushTest_NurbsCurve.gh (Grasshopper 1.0.7)

range = Range(Domain=Domain(0, 1), Steps=Slider(33, range=0..100))
crv = Curve(<curve referenced from the Rhino model>)
crv_2 = Curve(<curve referenced from the Rhino model>)
graph = GraphMapper(
    range,
    x0=0,
    x1=1,
    y0=0,
    y1=1,
    container_name="Bezier",
    cpx=[0, 0.9662767649, 0.7615688443, 1],
    cpy=[0, 0.1913408041, 0.5206542015, 1])
tweencrv = TweenCurve(CurveA=crv_2, CurveB=crv, Factor=graph, BlendType=0)
