# Grasshopper definition ParasitePushTest_Surface.gh (Grasshopper 1.0.7)
# plug-ins: ParasiteIOGrasshopper

srf = Surface(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)
bbox = BoundingBox(Content=srf, Plane=PlaneXY(0, 0, 0))  # -> Box, Box_2
volume = Volume(Geometry=bbox.Box)  # -> Volume, Centroid
scale = Scale(Geometry=srf, Center=volume.Centroid, Factor=Slider(20, range=0..100))  # -> Geometry, Transform
send = Send(Send=Toggle(False), Id="SurfaceFromGH", Data=scale.Geometry)
c_script = CSharpScript(x=scale.Geometry)  # -> out, A, B; inputs x: Surface
# ---------- c_script: C# usings ----------
using Rhino.Geometry.Collections;
using System.Linq;
using System.IO;
# ---------- c_script: C# ----------
     DataTree<Point3d> vertices = new  DataTree<Point3d> ();
    NurbsSurfacePointList cp = null;
    double[][] verts = null;
    if(x is Rhino.Geometry.NurbsSurface)
    {
      NurbsSurface ns = x as NurbsSurface;
    
      cp = ns.Points;
      verts = new double[cp.Count()][];
   
      
      int count = -1;
      foreach (var item in cp)
      {
                            
        count++;
           Print(count.ToString());
        //if (item.Weight <= 1e-11)
         // weights[count] = new double[] { 0.0 };
          
       // weights[count] = new double[] { item.Weight };
        verts[count] = new double[] { item.X, item.Y, item.Z };
      }
     
     
    }

    JaggedArrayToTxtFile(verts, Environment.GetFolderPath(Environment.SpecialFolder.Desktop),"wdwedwe.txt");
    
    A = cp.Select(a => a.Location).ToArray();
    B = verts;
# ---------- c_script: C# additional code ----------
  public  void JaggedArrayToTxtFile( double[][] data, string folderPath, string fileName)
  {

  string arrayString = "";
  string fullPath = Path.Combine(folderPath, fileName);
  for (int i = 0; i < data.Length; i++)
  {

  arrayString += string.Format("Element" + "{0}" + " ", "{" + i + "}");

  for (int j = 0; j < data[i].Length; j++)
  {
  arrayString += string.Format("{0}{1}", data[i][j], j == (data[i].Length - 1) ? "" : " ");
}
                arrayString += System.Environment.NewLine;
            }


            System.IO.File.WriteAllText(fullPath, arrayString);

        }
# ---------- end c_script ----------
srfpt = SurfacePoints(Surface=scale.Geometry)  # -> Points, Weights, Greville, UCount, VCount
panel = Panel(c_script.A)
