# Grasshopper definition ReceiveDynamoWalls.gh (Grasshopper 1.0.7)
# plug-ins: ParasiteIOGrasshopper

c_script = CSharpScript()  # -> out, A
# ---------- c_script: C# ----------
List<List<object>> outPut = new List<List<object>>();
    
    for (int i = 0; i < 10; i++)
    {
      List<object> data = new List<object>();

      for (int j = 0; j < 5; j++)
      {        
        data.Add("de");
      }
      outPut.Add(data);
    }
    
    
    for (int i = 0; i < GrasshopperDocument.ActiveObjects().Count; i++)
    {
      if(GrasshopperDocument.ActiveObjects()[i].Name == "Receive")
      {
      
        IGH_Component comp = GrasshopperDocument.ActiveObjects()[i] as IGH_Component;
        
        Print(comp.Params.Output.Count.ToString());
        break;
      }
      
    }
   A= outPut.Count;
# ---------- end c_script ----------
receive = Receive(Id="dynW")  # -> Data0, Data1, Data2
debrep = DeconstructBrep()  # -> Faces, Edges, Vertices

# ---- group: Cheking for lineariy
c_script_2 = CSharpScript(x=flatten(debrep.Edges))  # -> out, A; inputs x: list of Curve
# ---------- c_script_2: C# usings ----------
using System.Linq;
# ---------- c_script_2: C# ----------
    A = x.Select(a => a.IsLinear()).ToList();
# ---------- end c_script_2 ----------

# ----
preview = CustomPreview(Geometry=receive.Data1, Material=ColourSwatch(SwatchColor=RGB(44, 62, 112)))
preview_2 = CustomPreview(Geometry=receive.Data0, Material=ColourSwatch(SwatchColor=RGB(173, 173, 173)))
preview_3 = CustomPreview(Geometry=receive.Data2, Material=ColourSwatch(SwatchColor=RGB(115, 6, 95)))
