# Grasshopper definition SampleForVideo.gh (Grasshopper 1.0.7)
# plug-ins: ParasiteIOGrasshopper, Human, LunchBox

number_slider = Slider(5, range=0..100)
number_slider_2 = Slider(5, range=0..100)
srf = Surface(<surface referenced from the Rhino model>)
crv = Curve(<curve referenced from the Rhino model>)
crv_2 = Curve(<curve referenced from the Rhino model>)
range = Range(Domain=Domain(0, 1), Steps=Slider(5, range=0..10))
quads = QuadPanels(Surface=srf, UDivisions=Slider(50, range=0..100), VDivisions=Slider(25, range=0..100))
tweencrv = TweenCurve(CurveA=crv_2, CurveB=crv, Factor=range, BlendType=0)
area = Area(Geometry=quads)  # -> Area, Centroid
srf_cp = SurfaceClosestPoint(Point=area.Centroid, Surface=quads)  # -> Point, UVPoint, Distance
klein = KleinSurface(
    UDivisions=96,
    VDivisions=91,
    RParameter=Slider(7, range=0..10),
    TParameter=Slider(1.5, range=0..2),
    Scale=Slider(16, range=0..20),
    Domain1=Domain(0, 12.56637061),
    Domain2=Domain(0, 3.141592654))
evalsrf = EvaluateSurface(Surface=quads, Point=srf_cp.UVPoint)  # -> Point, Normal, UDirection, VDirection, Frame
lng = ListLength(List=quads)
previewlw = CustomPreviewLineweights(
    Geometry=[tweencrv, crv, crv_2],
    Shader={diffuse=RGB(255, 105, 180), emission=RGB(76, 32, 54), shine=0.5, specular=RGB(255, 255, 255), transparency=0},
    Thickness=Slider(2, range=0..10),
    Absolute=False)
mesh_uv = MeshSurface(Surface=klein, UCount=Slider(200, range=0..200), VCount=Slider(28, range=0..100), Overhang=True, Equalize=False)
deplane = DeconstructPlane(Plane=evalsrf.Frame)  # -> Origin, XAxis, YAxis, ZAxis
range_2 = Range(Domain=Domain(0, 1), Steps=lng)
pl = ConstructPlane(Origin=deplane.Origin, XAxis=deplane.YAxis, YAxis=deplane.ZAxis)
graph = GraphMapper(range_2, x0=0, x1=1, y0=0, y1=1, Cx=0.7551013231, Cy=0.3367495537, container_name="Conic")
send = Send(Id="GH_NurbsCrvs", Data=tweencrv)
preview = CustomPreview(Geometry=mesh_uv, Material=ColourSwatch(SwatchColor=RGB(240, 240, 240)))
dom = ConstructDomain(DomainStart=Slider(0, range=0..100), DomainEnd=Slider(360, range=0..1000))
send_2 = Send(Id="GH_Mesh", Data=mesh_uv)
remap = RemapNumbers(Value=graph, Source=Domain(0, 1), Target=dom)  # -> Mapped, Clipped
rotate = Rotate(Geometry=quads, Angle=degrees(remap.Mapped), Plane=pl)  # -> Geometry, Transform
area_2 = Area(Geometry=rotate.Geometry)  # -> Area, Centroid
scale = Scale(Geometry=rotate.Geometry, Center=area_2.Centroid, Factor=Slider(0.99, range=0..1))  # -> Geometry, Transform
preview_2 = CustomPreview(Geometry=scale.Geometry, Material=ColourSwatch(SwatchColor=RGB(240, 240, 240)))
brep = Brep(scale.Geometry)
send_3 = Send(Id="GH_Srfs", Data=brep)
